# Grasshopper definition LIGHTWEAVE.gh (Grasshopper 0.9.76)
# Copyright: Ripon DeLeon
# plug-ins: SonicBranchCount, Kangaroo Components

# ---- group: LED REFERENCE LOOP
crv = Curve(<curve referenced from the Rhino model>)

# ---- group: LED Profiles
crv_2 = Curve([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])

# ----
panel = Panel("""0-EAST FACING
1-WEST FACING""")

# ---- group: S2-COLUMN PTS
pt = Point(reverse(flatten([<point referenced from the Rhino model> x3])))

# ----
section = Slider(6, range=1..6)
solo = BooleanToggle(False)

# ---- group: ORIENTATION DIRECTION
small_panel = Panel("""0
1
0
0
1
0""")

# ---- group: N1-COLUMN PTS
pt_2 = Point(flatten([<point referenced from the Rhino model> x4]))

# ---- group: N2-COLUMN PTS
pt_3 = Point(flatten([<point referenced from the Rhino model> x3]))

# ---- group: N3-COLUMN PTS
pt_4 = Point(flatten([<point referenced from the Rhino model> x4]))

# ---- group: S1-COLUMN PTS
pt_5 = Point(flatten([<point referenced from the Rhino model> x6]))

# ---- group: S3-COLUMN PTS
pt_6 = Point(flatten([<point referenced from the Rhino model> x4]))

# ---- group: N3-REF PLAN CURVE INSIDE
crv_3 = Curve(<curve referenced from the Rhino model>)

# ---- group: S1-REF PLAN CURVE INSIDE
crv_4 = Curve(<curve referenced from the Rhino model>)

# ---- group: N3-REF PLAN OUTSIDE CURVE
crv_5 = Curve(<curve referenced from the Rhino model>)

# ---- group: S3-REF PLAN OUTSIDE CURVE
crv_6 = Curve(<curve referenced from the Rhino model>)

# ---- group: N1-REF PLAN CURVE INSIDE
crv_7 = Curve(<curve referenced from the Rhino model>)

# ---- group: N2-REF PLAN CURVE INSIDE
crv_8 = Curve(<curve referenced from the Rhino model>)

# ---- group: S2-REF PLAN CURVE INSIDE
crv_9 = Curve(<curve referenced from the Rhino model>)

# ---- group: S3-REF PLAN CURVE INSIDE
crv_10 = Curve(<curve referenced from the Rhino model>)

# ---- group: N1-REF PLAN OUTSIDE CURVE
crv_11 = Curve(<curve referenced from the Rhino model>)

# ---- group: N2-REF PLAN OUTSIDE CURVE
crv_12 = Curve(<curve referenced from the Rhino model>)

# ---- group: S1-REF PLAN OUTSIDE CURVE
crv_13 = Curve(<curve referenced from the Rhino model>)

# ---- group: S2-REF PLAN OUTSIDE CURVE
crv_14 = Curve(<curve referenced from the Rhino model>)

# ---- group: LED DIRECTION
small_panel_2 = Panel("""0
0
0
1
1
1""")

# ----
graft = GraftTree(Tree=small_panel, IncludeEmptyLists=True, IncludeNullItems=True)
graft_2 = GraftTree(Tree=small_panel_2, IncludeEmptyLists=True, IncludeNullItems=True)
entwine = Entwine(Branch00=pt_2, Branch01=pt_3, Branch02=pt_4, Branch03=pt_5, Branch04=pt, Branch05=pt_6, FlattenInputs=True)
entwine_2 = Entwine(Branch00=crv_7, Branch01=crv_8, Branch02=crv_3, Branch03=crv_4, Branch04=crv_9, Branch05=crv_10, FlattenInputs=True)
entwine_3 = Entwine(Branch00=crv_11, Branch01=crv_12, Branch02=crv_5, Branch03=crv_13, Branch04=crv_14, Branch05=crv_6, FlattenInputs=True)
viewer = ParamViewer(entwine)
subtraction = Subtraction(A=section, B=1)
item = ListItem(List=viewer, Index=subtraction, Wrap=True)

# ---- group: SOUTH MID LINE
crv_15 = Curve(<curve referenced from the Rhino model>)

# ---- group: NORTH MID LINE
crv_16 = Curve(<curve referenced from the Rhino model>)

# ----
weave = Weave(Pattern=solo, Stream0=viewer, Stream1=item, NullGaps=False)  # -> flatten(Weave)
branch = TreeBranch(Tree=graft, Path=weave, MaintainPaths=True)
branch_2 = TreeBranch(Tree=graft_2, Path=weave, MaintainPaths=True)
branch_3 = TreeBranch(Tree=entwine, Path=weave, MaintainPaths=True)
repeat = RepeatData(Data=graft([crv_16, crv_15]), Length="3")  # -> flatten(Data)
graft_3 = GraftTree(Tree=repeat, IncludeEmptyLists=True, IncludeNullItems=True)
pt_7 = Point(branch_3)
branch_4 = TreeBranch(Tree=graft_3, Path=weave, MaintainPaths=True)
range = Range(Domain=Domain(0, 1), Steps=Slider(10, range=0..100))
crv_17 = Curve(branch_4)
branch_5 = TreeBranch(Tree=entwine_2, Path=weave, MaintainPaths=True)
branch_6 = TreeBranch(Tree=entwine_3, Path=weave, MaintainPaths=True)
eval = EvaluateCurve(Curve=reparameterize(crv_17), Parameter=range)  # -> Point, Tangent, Angle
Y = UnitY(Factor=1)
rev = Reverse(Vector=Y)
Z = UnitZ(Factor=1)
Y_2 = UnitY(Factor=1)
dprod = DotProduct(VectorA=eval.Tangent, VectorB=Y, Unitize=True)
dprod_2 = DotProduct(VectorA=eval.Tangent, VectorB=Y_2, Unitize=True)
rev_2 = Reverse(Vector=Z)
pi = Pi(Factor=0.5)
bnd = Bounds(Numbers=dprod)
bnd_2 = Bounds(Numbers=dprod_2)
Z_2 = UnitZ(Factor=1)
pi_2 = Pi(Factor=0.5)
vrot = Rotate(Vector=eval.Tangent, Axis=rev_2, Angle=pi)
remap = RemapNumbers(Value=dprod, Source=bnd, Target=Slider(20, range=0..100))  # -> Mapped, Clipped
remap_2 = RemapNumbers(Value=dprod_2, Source=bnd_2, Target=Slider(40, range=0..100))  # -> Mapped, Clipped
vrot_2 = Rotate(Vector=eval.Tangent, Axis=Z_2, Angle=pi_2)
multiplication = Multiplication(A=vrot, B=remap.Mapped)
multiplication_2 = Multiplication(A=vrot_2, B=remap_2.Mapped)
addition = Addition(A=eval.Point, B=multiplication)
addition_2 = Addition(A=eval.Point, B=multiplication_2)
number_slider = Slider(96, range=0..100)
nurbs = NurbsCurve(Vertices=addition_2, Degree=3, Periodic=False)  # -> Curve, Length, Domain
int = Integer(branch)
int_2 = Integer(branch)
nurbs_2 = NurbsCurve(Vertices=addition, Degree=3, Periodic=False)  # -> Curve, Length, Domain
neg = Negative(Value=number_slider)
planar = Planar(Curve=branch_5)  # -> Planar, Plane, Deviation
p_n_c = PickNChoose(Pattern=int_2, Stream0=neg, Stream1=number_slider)
p_n_c_2 = PickNChoose(Pattern=int, Stream0=nurbs.Curve, Stream1=nurbs_2.Curve)
offset = Offset(Curve=p_n_c_2, Distance=p_n_c, Plane=PlaneXY(0, 0, 0), Corners=1)

# ---- group: outside+elevation
crv_18 = Curve(branch_6)

# ----
pshift = ShiftPaths(Data=offset, Offset=-1)
end = EndPoints(Curve=branch_5)  # -> Start, End
reb = RebuildCurve(Curve=pshift, Count=Slider(7, range=0..10), Tangents=False)
end_2 = EndPoints(Curve=crv_18)  # -> Start, End
yz = YZPlane(Origin=[end.Start, end.End])
yz_2 = YZPlane(Origin=[end_2.Start, end_2.End])
pcx = CurvePlane(Curve=reb, Plane=yz)  # -> Points, ParamsC, ParamsP
pcx_2 = CurvePlane(Curve=p_n_c_2, Plane=yz_2)  # -> Points, ParamsC, ParamsP
pshift_2 = ShiftPaths(Data=pcx.ParamsC, Offset=-1)
pshift_3 = ShiftPaths(Data=pcx_2.ParamsC, Offset=-1)
bnd_3 = Bounds(Numbers=pshift_2)
bnd_4 = Bounds(Numbers=pshift_3)
number_slider_2 = Slider(3, range=0..10)
bent_outer_profile = BooleanToggle(False)
subcrv = SubCurve(BaseCurve=p_n_c_2, Domain=bnd_4)
subcrv_2 = SubCurve(BaseCurve=reb, Domain=bnd_3)
plfit = PlaneFit(Points=pt_7)  # -> Plane, Deviation
simplify = SimplifyCurve(Curve=subcrv_2, Tolerance=Slider(25, range=0..100))  # -> Curve, Simplified

# ---- group: REF PLAN CURVE INSIDE
crv_19 = Curve(subcrv)

# ----
p_n_c_3 = PickNChoose(Pattern=bent_outer_profile, Stream0=crv_18, Stream1=simplify.Curve)
project = Project(Geometry=p_n_c_3, Plane=plfit.Plane)  # -> Geometry, Transform

# ---- group: REF PLAN OUTSIDE CURVE
crv_20 = Curve(project.Geometry)

# ----
_3d_geo = BooleanToggle(True)

tapered_box_beam = BooleanToggle(True)
pipe_beam_indent_offset = Slider(6, range=0..10)
beam_depth = Slider(8, range=0..10)
box_beam_width = Slider(4, range=0..10)

metal_pipe_bend_radius = Slider(5.5, range=0..10)
metal_pipe_radius = Slider(0.58, range=0..1)

aligned_sections = BooleanToggle(True)
bottom_triangle_bend = ValueList({"CENTER": 0, "SINE": 1, "EXAGGERATED": 2}, selected="EXAGGERATED")
led_loop_orientation = ValueList({"FIXED": 0, "SINE": 1, "CURVATURE": 2}, selected="FIXED")
led_loop_sizes = ValueList({"ONE LENGTH": 0, "TAPERED ENDS": 1, "EXHAGGERATED LENGTH": 2}, selected="TAPERED ENDS")
leds_both_directions = BooleanToggle(False)
mounting_plate_thickness = Slider(0.187, range=0..10)
led_bend_radius = Slider(3, range=0..10)
number_of_led_loop_sizes = Slider(5, range=0..10)
minimum_led_size_scale_factor = Slider(0.75, range=0..10)
maximum_led_size_scale_factor = Slider(1, range=0..10)
number_slider_3 = Slider(96, range=0..100)
pline = PolyLine(Vertices=pt_7, Closed=False)
ext = ExtendCurve(Curve=pline, Type=0, Start=number_slider_3, End=number_slider_3)
lng = ListLength(List=pt_7)
Z_3 = UnitZ(Factor=1)
neg_2 = Negative(Value=Slider(156, range=0..1000))
reb_2 = RebuildCurve(Curve=ext, Count=lng, Tangents=False)
end_3 = EndPoints(Curve=ext)  # -> Start, End
line = LineSDL(Start=pt_7, Direction=Z_3, Length=neg_2)
explode = Explode(Curve=reb_2, Recursive=True)  # -> Segments, Vertices
ln = Line(StartPoint=end_3.Start, EndPoint=end_3.End)
pipe = Pipe(Curve=line, Radius=Slider(2.78, range=0..10), Caps=0)
pshift_4 = ShiftPaths(Data=explode.Vertices, Offset=-1)
crv_cp = CurveClosestPoint(Point=pt_7, Curve=ln)  # -> Point, Parameter, Distance

# ---- group: COLUMN
brep = Brep(pipe)

brep_2 = Brep(brep)

# ----
pshift_5 = ShiftPaths(Data=brep_2, Offset=-1)
avr = Average(Input=pshift_4)
long = LongestList(ListA="COLUMN", ListB=pshift_5, PaddingMode=2)  # -> ListA, ListB
X = UnitX(Factor=1)
shatter = Shatter(Curve=ln, Parameters=crv_cp.Parameter)
number_slider_4 = Slider(16, range=0..100)
crv_cp_2 = CurveClosestPoint(Point=avr, Curve=ln)  # -> Point, Parameter, Distance
pshift_6 = ShiftPaths(Data=shatter, Offset=-1)
dprod_3 = DotProduct(VectorA=ln, VectorB=X, Unitize=True)

# ---- group: REF PLAN CURVE INSIDE
crv_21 = Curve(crv_19)

# ---- group: REF PLAN OUTSIDE CURVE
crv_22 = Curve(crv_20)

# ----
vec2pt = Vector2Pt(PointA=crv_cp_2.Point, PointB=avr, Unitize=False)  # -> Vector, Length
len = Length(Curve=pshift_6)
Y_3 = UnitY(Factor=1)

# ---- group: REF PLAN OUTSIDE CURVE
crv_23 = Curve(crv_20)

# ---- group: REF PLAN CURVE INSIDE
crv_24 = Curve(crv_19)

# ---- group: REF PLAN OUTSIDE CURVE
crv_25 = Curve(crv_20)

# ---- group: REF PLAN CURVE INSIDE
crv_26 = Curve(crv_19)

crv_27 = Curve(crv_19)

# ---- group: REF PLAN OUTSIDE CURVE
crv_28 = Curve(crv_20)

# ----
number_slider_5 = Slider(20, range=0..100)
number_slider_6 = Slider(0.1, range=0..1)
number_slider_7 = Slider(0.5, range=0..1)
divide = DivideCurve(Curve=crv_27, Count=number_slider_5, Kinks=False)  # -> Points, Tangents, Parameters
divide_2 = DivideCurve(Curve=crv_28, Count=number_slider_5, Kinks=False)  # -> Points, Tangents, Parameters
range_2 = Range(Domain=Domain(0, 1), Steps=number_slider_5)
subtraction_2 = Subtraction(A=number_slider_7, B=number_slider_6)
addition_3 = Addition(A=number_slider_7, B=number_slider_6)
graph = GraphMapper(
    range_2,
    x0=0,
    x1=1,
    y0=0,
    y1=1,
    container_name="Sine",
    Equation_px=[0.2391304374, 0.7376815081],
    Equation_py=[0.01884043217, 1])
ln_2 = Line(StartPoint=divide.Points, EndPoint=divide_2.Points)
dom = ConstructDomain(DomainStart=subtraction_2, DomainEnd=addition_3)
remap_3 = RemapNumbers(Value=graph, Source=Domain(0, 1), Target=dom)  # -> Mapped, Clipped
eval_2 = EvaluateCurve(Curve=reparameterize(ln_2), Parameter=remap_3.Mapped)  # -> Point, Tangent, Angle
nurbs_3 = NurbsCurve(Vertices=eval_2.Point, Degree=3, Periodic=False)  # -> Curve, Length, Domain
pshift_7 = ShiftPaths(Data=nurbs_3.Curve, Offset=-1)

tweencrv = TweenCurve(CurveA=crv_21, CurveB=crv_22, Factor=Slider(0.5, range=0..1), BlendType=0)

smaller = SmallerThan(FirstNumber=dprod_3, SecondNumber="0")  # -> SmallerThan, OrEqualTo
neg_3 = Negative(Value=number_slider_4)
division = Division(A=len, B=Slider(24, range=0..100))
dprod_4 = DotProduct(VectorA=Y_3, VectorB=vec2pt.Vector, Unitize=True)
range_3 = Range(Domain=Domain(0, 1), Steps=Slider(2, range=0..10))
number_slider_8 = Slider(3, range=0..10)
range_4 = Range(Domain=Domain(0, 1), Steps=Slider(2, range=0..10))
p_n_c_4 = PickNChoose(Pattern=smaller.SmallerThan, Stream0=neg_3, Stream1=number_slider_4)
round = Round(Number=division)  # -> Nearest, Floor, Ceiling
rev_3 = Reverse(Vector=vec2pt.Vector)
eval_3 = MidPointOnCurve(Curve=reparameterize(crv_24), Parameter=range_3)  # -> Point, Tangent, Angle
eval_4 = MidPointOnCurve(Curve=reparameterize(crv_23), Parameter=range_3)  # -> Point, Tangent, Angle
division_2 = Division(A=p_n_c_4, B=2)
eval_5 = MidPointOnCurve(Curve=reparameterize(crv_26), Parameter=range_4)  # -> Point, Tangent, Angle
smaller_2 = SmallerThan(FirstNumber=dprod_4, SecondNumber="0")  # -> SmallerThan, OrEqualTo
eval_6 = MidPointOnCurve(Curve=reparameterize(crv_25), Parameter=range_4)  # -> Point, Tangent, Angle
X_2 = UnitX(Factor=1)

# ---- group: MOUNTING PLATE THICKNESS
num = Number(mounting_plate_thickness)

# ---- group: PIPE BEND RADIUS
num_2 = Number(metal_pipe_bend_radius)

# ---- group: BOX BEAM DEPTH
num_3 = Number(beam_depth)

# ---- group: BOX BEAM WIDTH
num_4 = Number(box_beam_width)

# ---- group: PIPE RADIUS
num_5 = Number(metal_pipe_radius)

# ----
trim_list_ends = TrimListEnds(
    List=round.Nearest,
    DomainStart=1,
    A=1,
    List_2=round.Nearest,
    DomainStart_2=1,
    A_2=1,
    List_3=trim_list_ends.List,
    List_4=trim_list_ends.List,
    Interval=trim_list_ends.Domain,
    Cycle=False,
    DomainStart_3=trim_list_ends.DomainStart,
    DomainEnd=trim_list_ends.Result,
    A_3=trim_list_ends.A,
    B=1,
    A_4=trim_list_ends.Length,
    B_2=trim_list_ends.Result,
    List_5=trim_list_ends.List,
    Index=trim_list_ends.Index,
    InternalDocument_plugin_version=(0, 9, 76),
    InternalDocument_DocumentHeader_PreviewMeshType=1,
    InternalDocument_DocumentHeader_PreviewNormal=RGBA(150, 0, 0, 100),
    InternalDocument_DocumentHeader_PreviewSelected=RGBA(0, 120, 0, 100),
    InternalDocument_DefinitionProperties_Projection_Zoom=1.953125)  # -> List, Index, List_2, Index_2
lng_2 = ListLength(List=round.Nearest)
item_2 = ListItem(List=reverse(round.Nearest), Index=0, Wrap=True)
item_3 = ListItem(List=round.Nearest, Index=0, Wrap=True)
pline_2 = PolyLine(Vertices=eval_4.Point, Closed=False)
pline_3 = PolyLine(Vertices=eval_3.Point, Closed=False)
pline_4 = PolyLine(Vertices=eval_6.Point, Closed=False)
pline_5 = PolyLine(Vertices=eval_5.Point, Closed=False)
subtraction_3 = Subtraction(A=lng_2, B=Slider(2, range=0..10))
pshift_8 = ShiftPaths(Data=trim_list_ends.List_2, Offset=-1)
tweencrv_2 = TweenCurve(CurveA=pline_3, CurveB=pline_2, Factor=0.5, BlendType=0)
tweencrv_3 = TweenCurve(CurveA=crv_24, CurveB=crv_23, Factor=0.5, BlendType=0)
tweencrv_4 = TweenCurve(CurveA=pline_5, CurveB=pline_4, Factor=0.5, BlendType=0)
tweencrv_5 = TweenCurve(CurveA=crv_26, CurveB=crv_25, Factor=0.5, BlendType=0)
addition_4 = Addition(A=item_2, B=number_slider_8)
addition_5 = Addition(A=item_3, B=number_slider_8)
not = GateNot(A="0")
repeat_2 = RepeatData(Data="0", Length=subtraction_3)
merge = Merge(Data1=addition_5, Data2=pshift_8, Data3=addition_4)
short = ShortestList(ListA=not, ListB=subtraction_3, ListC=Slider(2, range=0..10), TrimMode=2)  # -> ListA, ListB, ListC
pshift_9 = ShiftPaths(Data=repeat_2, Offset=-1)
multiplication_3 = Multiplication(A=merge, B=2)
merge_2 = Merge(Data1=short.ListA, Data2=pshift_9, Data3=short.ListC)  # -> graft(Result)
Z_4 = UnitZ(Factor=1)
range_5 = Range(Domain=Domain(0, 1), Steps=multiplication_3)
neg_4 = Negative(Value=division_2)
unit = UnitVector(Vector=ln)
number_slider_9 = Slider(43, range=0..100)
graph_2 = GraphMapper(
    range_5,
    x0=0,
    x1=1,
    y0=0,
    y1=1,
    container_name="Bezier",
    cpx=[0, 0.1926481873, 0.4362315238, 1],
    cpy=[0, 0.2067825794, 0.7304347754, 1])
p_n_c_5 = PickNChoose(Pattern=smaller_2.SmallerThan, Stream0=rev_3, Stream1=vec2pt.Vector)
small_panel_3 = Panel("""0
1""")
multiplication_4 = Multiplication(A=unit, B=neg_4)
multiplication_5 = Multiplication(A=unit, B=division_2)
Z_5 = UnitZ(Factor=1)
vec = Vector(p_n_c_5)
subtraction_4 = Subtraction(A=1, B=graph_2)  # -> reverse(Result)
neg_5 = Negative(Value=Z_5)
weave_2 = Weave(Pattern=merge_2, Stream0=range_5, Stream1=subtraction_4, Stream2=graph_2, NullGaps=False)
cull = CullPattern(List=weave_2, CullPattern=small_panel_3)
eval_7 = EvaluateCurve(Curve=reparameterize(graft(pshift_6)), Parameter=cull)  # -> Point, Tangent, Angle
pshift_10 = ShiftPaths(Data=eval_7.Point, Offset=-1)
lng_3 = ListLength(List=pshift_10)

# ---- group: ASSEMBLY COUNTS
int_3 = Integer(lng_3)

int_4 = Integer(int_3)

int_5 = Integer(int_3)

# ----
subtraction_5 = Subtraction(A=int_4, B=1)
subtraction_6 = Subtraction(A=int_5, B=1)
divide_3 = DivideCurve(Curve=crv_24, Count=subtraction_5, Kinks=False)  # -> Points, Tangents, Parameters
divide_4 = DivideCurve(Curve=crv_23, Count=subtraction_5, Kinks=False)  # -> Points, Tangents, Parameters
divide_5 = DivideCurve(Curve=crv_26, Count=subtraction_6, Kinks=False)  # -> Points, Tangents, Parameters
divide_6 = DivideCurve(Curve=crv_25, Count=subtraction_6, Kinks=False)  # -> Points, Tangents, Parameters
ln_3 = Line(StartPoint=divide_3.Points, EndPoint=divide_4.Points)
ln_4 = Line(StartPoint=divide_5.Points, EndPoint=divide_6.Points)
dprod_5 = DotProduct(VectorA=divide_3.Points, VectorB=X_2, Unitize=False)
pshift_11 = ShiftPaths(Data=ln_3, Offset=-1)
pshift_12 = ShiftPaths(Data=ln_4, Offset=-1)
ccx = CurveCurve(CurveA=tweencrv_3, CurveB=pshift_11)  # -> Points, ParamsA, ParamsB
ccx_2 = CurveCurve(CurveA=tweencrv_2, CurveB=pshift_11)  # -> Points, ParamsA, ParamsB
ccx_3 = CurveCurve(CurveA=tweencrv_5, CurveB=pshift_12)  # -> Points, ParamsA, ParamsB
ccx_4 = CurveCurve(CurveA=tweencrv_4, CurveB=pshift_12)  # -> Points, ParamsA, ParamsB
vec2pt_2 = Vector2Pt(PointA=ccx_2.Points, PointB=ccx.Points, Unitize=False)  # -> Vector, Length
vec2pt_3 = Vector2Pt(PointA=ccx_4.Points, PointB=ccx_3.Points, Unitize=False)  # -> Vector, Length
multiplication_6 = Multiplication(A=vec2pt_2.Vector, B=Slider(1.5, range=0..10))
multiplication_7 = Multiplication(A=vec2pt_3.Vector, B=Slider(1.5, range=0..10))
addition_6 = Addition(A=ccx_2.Points, B=multiplication_6)
addition_7 = Addition(A=ccx_4.Points, B=multiplication_7)
pshift_13 = ShiftPaths(Data=addition_6, Offset=-1)
pshift_14 = ShiftPaths(Data=addition_7, Offset=-1)
nurbs_4 = NurbsCurve(Vertices=pshift_13, Degree=3, Periodic=False)  # -> Curve, Length, Domain
nurbs_5 = NurbsCurve(Vertices=pshift_14, Degree=3, Periodic=False)  # -> Curve, Length, Domain

# ---- group: BOX BEAM DEPTH
num_6 = Number(beam_depth)

# ----
addition_8 = Addition(A=pshift_10, B=multiplication_5)
p_n_c_6 = PickNChoose(Pattern=bottom_triangle_bend, Stream0=tweencrv, Stream1=pshift_7, Stream2=nurbs_5.Curve)

# ---- group: CENTERLINE
crv_29 = Curve(p_n_c_6)

# ----
pl = PlaneNormal(Origin=addition_8, ZAxis=unit)
addition_9 = Addition(A=pshift_10, B=multiplication_4)
pcx_3 = CurvePlane(Curve=crv_18, Plane=pl)  # -> Points, ParamsC, ParamsP
xy = XYPlane(Origin=pcx_3.Points)
pl_2 = PlaneNormal(Origin=addition_9, ZAxis=unit)

# ---- group: CENTERLINE
crv_30 = Curve(crv_29)

# ----
cp = PlaneClosestPoint(Point=graft(pl), Plane=xy)  # -> Point, UVPoint, Distance
pcx_4 = CurvePlane(Curve=crv_30, Plane=pl_2)  # -> Points, ParamsC, ParamsP
pcx_5 = CurvePlane(Curve=crv_30, Plane=pl)  # -> Points, ParamsC, ParamsP
abs = Absolute(Value=cp.Distance)
bnd_5 = Bounds(Numbers=flatten(abs))
remap_4 = RemapNumbers(Value=abs, Source=bnd_5, Target=Domain(0, 1))  # -> Mapped, Clipped
graph_3 = GraphMapper(remap_4.Mapped, x0=0, x1=1, y0=0, y1=1, container_name="Bezier", cpx=[0, 0, 1, 1], cpy=[0, 0.350404799, 0.604475379, 1])
dom_2 = ConstructDomain(DomainStart=Slider(40, range=0..100), DomainEnd=Slider(20, range=0..100))
Y_4 = UnitY(Factor=1)
remap_5 = RemapNumbers(Value=graph_3, Source=Domain(0, 1), Target=dom_2)  # -> Mapped, Clipped
multiplication_8 = Multiplication(A=Y_4, B=Slider(500, range=0..1000))
extrude_from_center = ExtrudeFromCenter(
    Base=crv_18,
    Vector=multiplication_8,
    Base_2=crv_18,
    Vector_2=multiplication_8,
    Vector_3=extrude_from_center.Vector,
    Base_3=extrude_from_center.Base,
    Direction=extrude_from_center.Vector,
    Geometry=extrude_from_center.Geometry,
    A=extrude_from_center.Vector,
    B=extrude_from_center.SmallPanel,
    Geometry_2=extrude_from_center.Extrusion,
    Translation=extrude_from_center.Result,
    InternalDocument_plugin_version=(0, 9, 76),
    InternalDocument_DocumentHeader_PreviewMeshType=1,
    InternalDocument_DocumentHeader_PreviewNormal=RGBA(150, 0, 0, 100),
    InternalDocument_DocumentHeader_PreviewSelected=RGBA(0, 150, 0, 100),
    InternalDocument_DefinitionProperties_Projection_Zoom=1)  # -> Geometry, Geometry_2
neg_6 = Negative(Value=remap_5.Mapped)
vrot_3 = Rotate(Vector=neg_5, Axis=vec, Angle=degrees(remap_5.Mapped))
long_2 = LongestList(ListA=pl, ListB=extrude_from_center.Geometry_2, PaddingMode=2)  # -> ListA, graft(ListB)
vrot_4 = Rotate(Vector=neg_5, Axis=vec, Angle=degrees(neg_6))
pl_3 = PlaneNormal(Origin=addition_9, ZAxis=unit)
line_2 = LineSDL(Start=pcx_5.Points, Direction=vrot_3, Length=number_slider_9)
tapered_assemblies = Slider(10, range=0..10)
rot3d = Rotate3D(Geometry=graft(pl_3), Angle=degrees(neg_6), Center=graft(addition_9), Axis=vec)  # -> Geometry, Transform
line_3 = LineSDL(Start=pcx_4.Points, Direction=vrot_4, Length=number_slider_9)
slx = SurfaceLine(Surface=long_2.ListB, Line=line_2, LimitToFirst=False)  # -> Curves, Points, UVPoints, Normal

# ---- group: REF PLAN CURVE INSIDE
crv_31 = Curve(crv_19)

# ---- group: REF PLAN OUTSIDE CURVE
crv_32 = Curve(crv_20)

# ---- group: ASSEMBLY COUNTS
int_6 = Integer(int_3)

# ----
slx_2 = SurfaceLine(Surface=long_2.ListB, Line=line_3, LimitToFirst=False)  # -> Curves, Points, UVPoints, Normal
pcx_6 = CurvePlane(Curve=crv_32, Plane=pl)  # -> Points, ParamsC, ParamsP
pshift_15 = ShiftPaths(Data=slx.Points, Offset=-1)
pcx_7 = CurvePlane(Curve=crv_31, Plane=pl)  # -> Points, ParamsC, ParamsP
long_3 = LongestList(ListA=int_6, ListB=tapered_assemblies, PaddingMode=2)  # -> ListA, ListB
subtraction_7 = Subtraction(A=long_3.ListB, B=1)
range_6 = Range(Domain=Domain(0, 1), Steps=subtraction_7)
merge_3 = Merge(Data1=pcx_7.Points, Data2=pshift_15, Data3=pcx_6.Points)
pshift_16 = ShiftPaths(Data=range_6, Offset=-1)
merge_4 = Merge(Data1=pshift_15, Data2=pcx_7.Points, Data3=pcx_6.Points)
multiplication_9 = Multiplication(A=long_3.ListB, B=2)
graph_4 = GraphMapper(
    pshift_16,
    x0=0,
    x1=1,
    y0=0,
    y1=1,
    container_name="Bezier",
    cpx=[0, 0.3761747181, 0.424408406, 1],
    cpy=[0, 0, 0.9993622303, 1])
subtraction_8 = Subtraction(A=long_3.ListA, B=multiplication_9)
repeat_3 = RepeatData(Data="1", Length=subtraction_8)
pshift_17 = ShiftPaths(Data=repeat_3, Offset=-1)
merge_5 = Merge(Data1=graph_4, Data2=pshift_17, Data3=reverse(graph_4))  # -> graft(Result)
subtraction_9 = Subtraction(A=1, B=merge_5)

# ---- group: CENTER LINE
pln = Plane(pl)

# ---- group: CENTERLINE
crv_33 = Curve(tweencrv)

# ----
pline_6 = PolyLine(Vertices=merge_4, Closed=True)
xy_2 = XYPlane(Origin=pcx_7.Points)
pcx_8 = CurvePlane(Curve=crv_33, Plane=pln)  # -> Points, ParamsC, ParamsP
pcx_9 = CurvePlane(Curve=pline_6, Plane=rot3d.Geometry)  # -> Points, ParamsC, ParamsP
pshift_18 = ShiftPaths(Data=slx_2.Points, Offset=-1)
pline_7 = PolyLine(Vertices=merge_3, Closed=False)
graft_4 = GraftTree(Tree=pln, IncludeEmptyLists=True, IncludeNullItems=True)
pshift_19 = ShiftPaths(Data=pcx_8.ParamsC, Offset=-1)
eval_8 = EvaluateCurve(Curve=crv_33, Parameter=pshift_19)  # -> graft(Point), graft(Tangent), Angle
pl_origin = PlaneOrigin(Base=graft_4, Origin=eval_8.Point)
pl_4 = PlaneNormal(Origin=eval_8.Point, ZAxis=eval_8.Tangent)
p_n_c_7 = PickNChoose(Pattern=aligned_sections, Stream0=pl_origin, Stream1=pl_4)
number_slider_10 = Slider(4, range=0..10)

# ---- group: LED DIRECTION
int_7 = Integer(branch_2)

# ----
bs = BranchCount(String=int_7)
series = Series(Start=0, Step=1, Count=number_slider_10)  # -> flatten(Series)
series_2 = Series(Start=0, Step=1, Count=bs)  # -> flatten(Series)
int_8 = Integer(series)
int_9 = Integer(graft(series_2))
number_slider_11 = Slider(4, range=0..10)
int_10 = Integer()

# ---- group: PIPE BEND RADIUS
num_7 = Number(metal_pipe_bend_radius)

# ---- group: PIPE RADIUS
num_8 = Number(metal_pipe_radius)

# ---- group: ASSEMBLY COUNTS
int_11 = Integer(int_3)

# ----
multiplication_10 = Multiplication(A=number_slider_10, B=2)

# ---- group: EXAGGERATED SPACING
num_9 = Number(vec2pt_3.Length)

# ----
subtraction_10 = Subtraction(A=int_11, B=multiplication_10)
number_slider_12 = Slider(500, range=0..1000)
pshift_20 = ShiftPaths(Data=num_9, Offset=-1)

# ---- group: TRIMED ASSEMBLY COUNTS
int_12 = Integer(subtraction_10)

# ----
bnd_6 = Bounds(Numbers=pshift_20)
subtraction_11 = Subtraction(A=int_12, B=1)
range_7 = Range(Domain=Domain(0, 2), Steps=subtraction_11)
pshift_21 = ShiftPaths(Data=range_7, Offset=-1)

# ---- group: MAXIMUM LED SIZE SCALE FACTOR
num_10 = Number(maximum_led_size_scale_factor)

# ---- group: LED LOOP COUNT
int_13 = Integer(number_of_led_loop_sizes)

# ---- group: LED REFERENCE LOOP
crv_34 = Curve(crv)

# ---- group: MINIMUM LED SIZE SCALE FACTOR
num_11 = Number(minimum_led_size_scale_factor)

# ----
subtraction_12 = Subtraction(A="1", B=pshift_21)
subtraction_13 = Subtraction(A=int_13, B=1)
abs_2 = Absolute(Value=subtraction_12)
dom_3 = ConstructDomain(DomainStart=num_11, DomainEnd=num_10)
range_8 = Range(Domain=Domain(0, 1), Steps=subtraction_11)
div = DivideDomain(Domain=Domain(0, 1), Count=int_13)  # -> reverse(Segments)
remap_6 = RemapNumbers(Value=pshift_20, Source=bnd_6, Target=Domain(0, 1))  # -> Mapped, Clipped
eval_9 = EvaluateCurve(Curve=reparameterize(crv_34), Parameter=Slider(0.18, range=0..1))  # -> Point, Tangent, Angle
division_3 = Division(A=int_13, B=2)
range_9 = Range(Domain=dom_3, Steps=subtraction_13)
graph_5 = GraphMapper(abs_2, x0=0, x1=1, y0=0, y1=1, container_name="Bezier", cpx=[0, 0.7333347201, 0.8492767811, 1], cpy=[0, 0, 1, 1])
number_slider_13 = Slider(2.7, range=0..10)
pshift_22 = ShiftPaths(Data=range_8, Offset=-1)  # -> graft(Data)
number_slider_14 = Slider(0.3, range=0..1)
scale = Scale(Geometry=crv_34, Center=eval_9.Point, Factor=range_9)  # -> Geometry, Transform
round_2 = Round(Number=division_3)  # -> Nearest, Floor, Ceiling
graph_6 = GraphMapper(
    pshift_22,
    x0=0,
    x1=1,
    y0=0,
    y1=1,
    container_name="Sine",
    Equation_px=[0.2470201403, 0.7430269718],
    Equation_py=[0.01248300076, 0.9955223203])
dom_4 = ConstructDomain(DomainStart=Slider(2.8, range=0..10), DomainEnd=Slider(2.8, range=0..10))
dom_5 = ConstructDomain(DomainStart=Slider(0.1, range=0..10), DomainEnd=Slider(0.1, range=0..1))
dom_6 = ConstructDomain(DomainStart=Slider(0.18, range=0..1), DomainEnd=Slider(0.18, range=0..1))
weave_3 = Weave(Pattern=led_loop_sizes, Stream0=round_2.Floor, Stream1=graph_5, Stream2=remap_6.Mapped, NullGaps=False)
neg_7 = Negative(Value=num_8)
remap_7 = RemapNumbers(Value=graph_6, Source=Domain(0, 1), Target=dom_4)  # -> Mapped, Clipped
remap_8 = RemapNumbers(Value=graph_6, Source=Domain(0, 1), Target=dom_5)  # -> Mapped, Clipped
remap_9 = RemapNumbers(Value=graph_6, Source=Domain(0, 1), Target=dom_6)  # -> Mapped, Clipped
fdom = FindDomain(Domains=div, Number=weave_3, Strict=False)  # -> Index, Neighbour

# ---- group: LED CENTERLINES
crv_35 = Curve(scale.Geometry)

# ----
item_4 = ListItem(List=crv_35, Index=fdom.Index, Wrap=True)  # -> graft(Item)
led_loop_profile_offset = Slider(1.125, range=0..10)
smooth_acrylic_movement = BooleanToggle(True)
eval_10 = EvaluateCurve(Curve=reparameterize(item_4), Parameter=remap_9.Mapped)  # -> Point, Tangent, Angle
xy_3 = XYPlane(Origin=eval_10.Point)
fillet = Fillet(Curve=item_4, Radius=led_bend_radius)

# ---- group: LED CENTERLINES
crv_36 = Curve(crv_35)

# ---- group: ASSEMBLY COUNTS
int_14 = Integer(int_3)

# ----
align = AlignPlane(Plane=xy_3, Direction=eval_10.Tangent)  # -> Plane, Angle

# ---- group: PROFILE
crv_37 = Curve(<curve referenced from the Rhino model>)

# ---- group: CENTERLINE
crv_38 = Curve(<curve referenced from the Rhino model>)

# ----
subtraction_14 = Subtraction(A=int_14, B=1)
range_10 = Range(Domain=Domain(0, 1), Steps=subtraction_14)
Y_5 = UnitY(Factor=1)
pshift_23 = ShiftPaths(Data=range_10, Offset=-1)
eval_11 = EvaluateCurve(Curve=reparameterize(crv_38), Parameter=pshift_23)  # -> Point, Tangent, Angle
line_4 = LineSDL(Start=eval_11.Point, Direction=Y_5, Length=1)
clx = CurveLine(Curve=crv_37, Line=line_4)  # -> Points, Params, Count
vec2pt_4 = Vector2Pt(PointA=graft(eval_11.Point), PointB=clx.Points, Unitize=False)  # -> Vector, Length
dprod_6 = DotProduct(VectorA=Y_5, VectorB=vec2pt_4.Vector, Unitize=True)
number_slider_15 = Slider(2, range=0..10)
multiplication_11 = Multiplication(A=dprod_6, B=vec2pt_4.Length)
number_slider_16 = Slider(0, range=0..100)
smaller_3 = SmallerThan(FirstNumber="0", SecondNumber=dprod_6)  # -> SmallerThan, OrEqualTo
pshift_24 = ShiftPaths(Data=multiplication_11, Offset=-1)
dom_7 = ConstructDomain(DomainStart=number_slider_16, DomainEnd=Slider(15, range=-90..90))
dom_8 = ConstructDomain(DomainStart=number_slider_16, DomainEnd=Slider(-15, range=-90..90))
dispatch = Dispatch(List=vec2pt_4.Length, DispatchPattern=smaller_3.SmallerThan)  # -> ListA, ListB
remap_10 = RemapNumbers(Value=dispatch.ListA, Source=number_slider_15, Target=dom_8)  # -> Mapped, Clipped
remap_11 = RemapNumbers(Value=dispatch.ListB, Source=number_slider_15, Target=dom_7)  # -> Mapped, Clipped
merge_6 = Merge(Data1=remap_10.Mapped, Data2=remap_11.Mapped)

number_slider_17 = Slider(100, range=0..1000)  # disabled
toggle = BooleanToggle(False)  # disabled
number_slider_18 = Slider(0.1, range=0..0.1)  # disabled
number_slider_19 = Slider(0.01, range=0..0.01)  # disabled

# ---- group: LED Profiles
crv_39 = Curve(crv_2)

# ----
fillet_2 = Fillet(Curve=crv_36, Radius=led_bend_radius)
explode_2 = Explode(Curve=fillet_2, Recursive=True)  # -> Segments, Vertices
pframe = PerpFrame(Curve=reparameterize(explode_2.Segments), Parameter=0)
Z_6 = UnitZ(Factor=1)
join = JoinCurves(Curves=crv_39, Preserve=False)
xy_4 = XYPlane(Origin=Point(0, 0, 0))
align_2 = AlignPlane(Plane=pframe, Direction=Z_6)  # -> Plane, Angle
orient = Orient(Geometry=join, Source=xy_4, Target=align_2.Plane)  # -> Geometry, Transform
cull_2 = CullPattern(List=explode_2.Segments, CullPattern=_3d_geo)
swp1 = Sweep1(Rail=graft(cull_2), Sections=graft(orient.Geometry), Miter=1)
pshift_25 = ShiftPaths(Data=swp1, Offset=-2)
debrep = DeconstructBrep(Brep=pshift_25)  # -> Faces, Edges, Vertices
split = SplitList(List=debrep.Faces, Index=1)  # -> ListA, ListB
pshift_26 = ShiftPaths(Data=split.ListA, Offset=-2)
pshift_27 = ShiftPaths(Data=split.ListB, Offset=-2)
join_2 = BrepJoin(Breps=pshift_26)  # -> Breps, Closed
join_3 = BrepJoin(Breps=pshift_27)  # -> Breps, Closed
group = Group(Objects=[join_2.Breps, join_3.Breps])
item_5 = ListItem(List=flatten(group), Index=fdom.Index, Wrap=True)  # -> graft(Item)

timer = Timer(TimerInterval=1, Target=counter)  # disabled
counter = Counter(Reset=toggle)  # disabled

# ---- group: PIPE RADIUS
num_12 = Number(metal_pipe_radius)

# ---- group: LED LOOP PROFILE OFFSET
num_13 = Number(led_loop_profile_offset)

# ----
Z_7 = UnitZ(Factor=1)
division_4 = Division(A=counter, B=number_slider_17)  # disabled
small_panel_4 = Panel(counter)  # disabled
addition_10 = Addition(A=number_slider_18, B=division_4)  # disabled
Z_8 = UnitZ(Factor=1)
addition_11 = Addition(A=num_12, B=num_13)
round_3 = Round(Number=division_4)  # -> Nearest, Floor, Ceiling; disabled
round_4 = Round(Number=addition_10)  # -> Nearest, Floor, Ceiling; disabled
number_slider_20 = Slider(25, range=0..100)
dom_9 = ConstructDomain(DomainStart=Slider(15, range=-90..90), DomainEnd=Slider(0, range=0..100))
neg_8 = Negative(Value=addition_11)
subtraction_15 = Subtraction(A=division_4, B=round_3.Floor)  # disabled
subtraction_16 = Subtraction(A=addition_10, B=round_4.Floor)  # disabled
neg_9 = Negative(Value=Slider(90, range=0..100))
xy_5 = XYPlane(Origin=Point(0, 0, 0))
dom_10 = ConstructDomain(DomainStart=subtraction_15, DomainEnd=subtraction_16)  # disabled
pi_3 = Pi(Factor=1)
small_panel_5 = Panel("""1
-1
1
1
-1
1""")
number_slider_21 = Slider(9, range=0..100)
small_panel_6 = Panel("1")
graft_5 = GraftTree(Tree=small_panel_5, IncludeEmptyLists=True, IncludeNullItems=True)

# ---- group: LED LENSE
brep_3 = Brep(join_2.Breps)

# ---- group: LED BACK
brep_4 = Brep(join_3.Breps)

# ----
small_panel_7 = Panel("""LED COUNT: 
TOTAL LENGTH: """)
small_panel_8 = Panel(""" LOOPS
 FEET""")
number_slider_22 = Slider(120, range=90..180)
not_2 = GateNot(A=_3d_geo)
neg_10 = Negative(Value=number_slider_22)
number_slider_23 = Slider(12, range=0..100)
merge_7 = Merge(Data1=neg_10, Data2=number_slider_22)  # -> reverse(Result)

# ---- group: ASSEMBLY COUNTS
int_15 = Integer(int_3)

# ----
number_slider_24 = Slider(100, range=0..100)
Z_9 = UnitZ(Factor=-25)

# ---- group: BOX BEAM WIDTH
num_14 = Number(box_beam_width)

# ----
division_5 = Division(A=num_14, B=2)
metal_loop_attachment_hole_diameter = Panel("1/4\"")

mounting_plate_tab_fillet = Slider(0.25, range=0..1)
mounting_plate_hole_diameter = Panel("3/8")
beam_tab_thickness = Slider(0.25, range=0..10)
c_p_extension = Slider(2, range=0..10)
plate_length = Slider(14, range=0..100)
beam_tab_length = Slider(8, range=0..10)
beam_tab_width = Slider(1.5, range=0..10)

# ---- group: BEAM TAB LENGTH
num_15 = Number(beam_tab_length)

# ---- group: BEAM TAB THICKNESS
num_16 = Number(beam_tab_thickness)

# ---- group: C/P EXTENSION
num_17 = Number(c_p_extension)

# ----
addition_12 = Addition(A=division_5, B=Slider(1, range=0..1))

# ---- group: METAL LOOP ATTACHMENT HOLE DIAMETER
num_18 = Number(metal_loop_attachment_hole_diameter)

# ----
division_6 = Division(A=num_18, B=2)

# ---- group: CONTROLLER/PWR ORIENTATION
int_16 = Integer([0, 1, 0, 0, 1, 0])

int_17 = Integer(graft(int_16))

# ----
repeat_4 = RepeatData(Data=graft(int_16), Length=int_15)

# ---- group: BEAM TAB LENGTH
num_19 = Number(beam_tab_length)

# ----
division_7 = Division(A=num_19, B=2)

# ---- group: C/P EXTENSION
num_20 = Number(c_p_extension)

# ----
pshift_28 = ShiftPaths(Data=repeat_4, Offset=-1)  # -> graft(Data)

# ---- group: PLATE LENGTH
num_21 = Number(plate_length)

# ----
addition_13 = Addition(A=num_20, B=division_7)

# ---- group: BEAM TAB LENGTH
num_22 = Number(beam_tab_width)

# ----
division_8 = Division(A=num_21, B=2)
neg_11 = Negative(Value=division_7)
neg_12 = Negative(Value=addition_13)
dom_11 = CENTEREDDomain(DomainStart=expr("-x/2", num_21), DomainEnd=expr("x/2", num_21))
subtraction_17 = Subtraction(A=division_8, B=num_22)
division_9 = Division(A=num_22, B=2)
dom_12 = ConstructDomain(DomainStart=neg_11, DomainEnd=division_7)
dom_13 = ConstructDomain(DomainStart=neg_12, DomainEnd=division_7)
subtraction_18 = Subtraction(A=division_7, B=division_9)
addition_14 = Addition(A=subtraction_17, B=division_9)
dom_14 = ConstructDomain(DomainStart=subtraction_17, DomainEnd=division_8)

# ---- group: MOUNTING PLATE/TAB FILLET
num_23 = Number(mounting_plate_tab_fillet)

# ----
neg_13 = Negative(Value=dom_14)

# ---- group: MOUNTING PLATE HOLE DIAMETER
num_24 = Number(mounting_plate_hole_diameter)

# ----
division_10 = Division(A=num_24, B=2)

# ---- group: BEAM TAB THICKNESS
num_25 = Number(beam_tab_thickness)

# ---- group: MOUNTING PLATE THICKNESS
num_26 = Number(mounting_plate_thickness)

# ---- group: PIPE RADIUS
num_27 = Number(metal_pipe_radius)

# ----
Z_10 = UnitZ(Factor=num_25)
Z_11 = UnitZ(Factor=num_26)
Z_12 = UnitZ(Factor=num_27)
addition_15 = Addition(A=Z_11, B=Z_12)

beam_cantilever_lengths = Slider(96, range=0..100)
pline_8 = PolyLine(Vertices=pt_7, Closed=False)
ext_2 = ExtendCurve(Curve=pline_8, Type=0, Start=beam_cantilever_lengths, End=beam_cantilever_lengths)
disc = Discontinuity(Curve=ext_2, Level=1)  # -> Points, Parameters
pline_9 = PolyLine(Vertices=disc.Points, Closed=False)
division_11 = Division(A=num_15, B=2)
division_12 = Division(A=num_2, B=2)
not_3 = GateNot(A=int_17)
explode_3 = Explode(Curve=pline_9, Recursive=True)  # -> Segments, Vertices
addition_16 = Addition(A=division_11, B=division_12)
addition_17 = Addition(A=num_3, B=num_5, C=num_16, D=num)
pshift_29 = ShiftPaths(Data=explode_3.Segments, Offset=-2)
addition_18 = Addition(A=addition_16, B=num_17)
pframe_2 = PerpFrame(Curve=reparameterize(pshift_29), Parameter=Slider(0, range=0..100))
len_2 = Length(Curve=pshift_29)
Z_13 = UnitZ(Factor=1)
merge_8 = Merge(Data1=addition_16, Data2=addition_18)
neg_14 = Negative(Value=addition_17)
vec_2 = Vector(pshift_29)
item_6 = ListItem(List=merge_8, Index=not_3, Wrap=True)
item_7 = ListItem(List=merge_8, Index=int_17, Wrap=True)
ma = MassAddition(Input=merge_8)  # -> Result, PartialResults
dom_15 = ConstructDomain(DomainStart=neg_14, DomainEnd=addition_17)
multiplication_12 = Multiplication(A=vec_2, B=len_2)
dom_16 = CENTEREDDomain(DomainStart=expr("-x/2", num_4), DomainEnd=expr("x/2", num_4))
align_3 = AlignPlane(Plane=pframe_2, Direction=Z_13)  # -> Plane, Angle
neg_15 = Negative(Value=num_3)
neg_16 = Negative(Value=item_6)
dom_17 = ConstructDomain(DomainStart=neg_16, DomainEnd=item_7)
rectangle = Rectangle(Plane=align_3.Plane, XSize=neg_15, YSize=dom_16, Radius=0)  # -> Rectangle, Length
extr = Extrude(Base=rectangle.Rectangle, Direction=multiplication_12)
small_panel_9 = Panel("""0
1""")
cap = CapHoles(Brep=extr)
number_slider_25 = Slider(60, range=0..100)
number_slider_26 = Slider(50, range=0..100)
neg_17 = Negative(Value=number_slider_25)
Z_14 = UnitZ(Factor=num_6)
rev_4 = Reverse(Vector=Z_14)
dom_18 = CENTEREDDomain(DomainStart=expr("-x/2", number_slider_26), DomainEnd=expr("x/2", number_slider_26))
neg_18 = Negative(Value=number_slider_26)

addition_19 = Addition(A=beam_cantilever_lengths, B=100)
ext_3 = ExtendCurve(Curve=pline_8, Type=0, Start=addition_19, End=addition_19)
disc_2 = Discontinuity(Curve=ext_3, Level=1)  # -> Points, Parameters

# ---- group: BEAM ANGLES / BEAM CENTERLINE
crv_40 = Curve(pline_9)

# ----
pline_10 = PolyLine(Vertices=disc_2.Points, Closed=False)

# ---- group: BEAM ANGLES
explode_4 = Explode(Curve=crv_40, Recursive=True)  # -> Segments, Vertices
shift = ShiftList(List=explode_4.Segments, Shift=-1, Wrap=False)
shift_2 = ShiftList(List=explode_4.Segments, Shift=1, Wrap=False)
end_4 = EndPoints(Curve=shift)  # -> Start, End
end_5 = EndPoints(Curve=shift_2)  # -> Start, End
angledim = AngularDimension(Center=end_4.End, PointA=end_4.Start, PointB=end_5.End, Reflex=False, Text="{0:0.0}°", Size=Slider(10, range=0..10))

# ----
explode_5 = Explode(Curve=pline_10, Recursive=True)  # -> Segments, Vertices
pshift_30 = ShiftPaths(Data=explode_5.Segments, Offset=-2)

# ---- group: BEAM CENTERLINE
crv_41 = Curve(pline_9)

# ----
pframe_3 = PerpFrame(Curve=reparameterize(pshift_30), Parameter=Slider(0, range=0..100))
len_3 = Length(Curve=pshift_30)

# ---- group: BOX BEAM REGION WIDTH
num_28 = Number(ma.Result)

# ----
vec_3 = Vector(pshift_30)
align_4 = AlignPlane(Plane=pframe_3, Direction=Z_4)  # -> Plane, Angle
multiplication_13 = Multiplication(A=vec_3, B=len_3)

rectangle_2 = Rectangle(Plane=align_4.Plane, XSize=dom_15, YSize=dom_17, Radius=0)  # -> Rectangle, Length
extr_2 = Extrude(Base=rectangle_2.Rectangle, Direction=multiplication_13)
pframe_4 = PerpFrame(Curve=reparameterize(crv_41), Parameter=small_panel_9)
cap_2 = CapHoles(Brep=extr_2)
deplane = DeconstructPlane(Plane=pframe_4)  # -> Origin, XAxis, YAxis, ZAxis
rot3d_2 = Rotate3D(Geometry=pframe_4, Angle=degrees([neg_17, number_slider_25]), Center=deplane.Origin, Axis=deplane.YAxis)  # -> Geometry, Transform
move = Move(Geometry=rot3d_2.Geometry, Motion=rev_4)  # -> Geometry, Transform
pshift_31 = ShiftPaths(Data=move.Geometry, Offset=-1)
box = DomainBox(Base=pshift_31, X=dom_18, Y=dom_18, Z=[neg_18, number_slider_26])
sdiff = SolidDifference(BrepsA=cap, BrepsB=box)
weave_4 = Weave(Pattern=tapered_box_beam, Stream0=cap, Stream1=sdiff, NullGaps=False)

# ---- group: STRUCTURAL BOX BEAM
brep_5 = Brep(weave_4)

brep_6 = Brep(brep_5)

# ----
long_4 = LongestList(ListA="BOX BEAMS", ListB=brep_6, PaddingMode=2)  # -> ListA, ListB
merge_9 = Merge(Data1=long_4.ListA, Data2=long.ListA)
merge_10 = Merge(Data1=long_4.ListB, Data2=long.ListB)

# ---- group: BEAM + MOUNTING DEPTH
num_29 = Number(addition_17)

# ----
neg_19 = Negative(Value=num_29)
multiplication_14 = Multiplication(A=subtraction_9, B=neg_19)
pl_offset = PlaneOffset(BasePlane=xy_2, Offset=multiplication_14)
pcx_10 = CurvePlane(Curve=pline_7, Plane=pl_offset)  # -> Points, ParamsC, ParamsP
pshift_32 = ShiftPaths(Data=pcx_10.Points, Offset=-1)
merge_11 = Merge(Data1=pshift_15, Data2=pshift_32)
pline_11 = PolyLine(Vertices=merge_11, Closed=True)
orient_2 = Orient(Geometry=pline_11, Source=pl_origin, Target=p_n_c_7)  # -> Geometry, Transform

# ---- group: EAST FACING
crv_42 = Curve(orient_2.Geometry)

# ----
pshift_33 = ShiftPaths(Data=crv_42, Offset=-1)
transform = Transform(Geometry=pshift_18, Transform=orient_2.Transform)
transform_2 = Transform(Geometry=pcx_9.Points, Transform=orient_2.Transform)
pshift_34 = ShiftPaths(Data=transform_2, Offset=-1)
planar_2 = Planar(Curve=orient_2.Geometry)  # -> Planar, Plane, Deviation
weave_5 = Weave(Pattern=[0, 1], Stream0=pshift_34, Stream1=transform, NullGaps=False)
offset_2 = Offset(Curve=orient_2.Geometry, Distance=num_8, Plane=planar_2.Plane, Corners=1)
disc_3 = Discontinuity(Curve=offset_2, Level=1)  # -> Points, Parameters
pline_12 = PolyLine(Vertices=weave_5, Closed=False)
pline_13 = PolyLine(Vertices=disc_3.Points, Closed=True)
ext_4 = ExtendCurve(Curve=pline_12, Type=0, Start=number_slider_12, End=number_slider_12)
pshift_35 = ShiftPaths(Data=pline_13, Offset=-2)
pcx_11 = CurvePlane(Curve=ext_4, Plane=pl_offset)  # -> Points, ParamsC, ParamsP
planar_3 = Planar(Curve=pshift_35)  # -> Planar, Plane, Deviation
pshift_36 = ShiftPaths(Data=pcx_11.Points, Offset=-1)
merge_12 = Merge(Data1=transform, Data2=pshift_36)
pline_14 = PolyLine(Vertices=merge_12, Closed=True)

# ---- group: WEST FACING
crv_43 = Curve(pline_14)

# ----
pshift_37 = ShiftPaths(Data=crv_43, Offset=-1)
lng_4 = ListLength(List=pshift_37)
merge_13 = Merge(Data1=graft(pshift_33), Data2=graft(pshift_37))
weave_6 = Weave(Pattern=int_7, Stream0=pshift_33, Stream1=pshift_37, NullGaps=False)
subtraction_19 = Subtraction(A=lng_4, B=1)
graft_6 = GraftTree(Tree=weave_6, IncludeEmptyLists=True, IncludeNullItems=True)
long_5 = LongestList(ListA=subtraction_19, ListB=int_8, PaddingMode=2)  # -> ListA, ListB
weave_7 = Weave(Pattern=leds_both_directions, Stream0=graft_6, Stream1=merge_13, NullGaps=False)
subtraction_20 = Subtraction(A=long_5.ListA, B=long_5.ListB)
merge_14 = Merge(Data1=long_5.ListB, Data2=reverse(subtraction_20))
long_6 = LongestList(ListA=Slider(0, range=0..100), ListC=int_9, ListB=merge_14, PaddingMode=2)  # -> graft(ListA), graft(ListC), graft(ListB)
pshift_38 = ShiftPaths(Data=weave_7, Offset=-1)
trim_list_ends_2 = TrimListEnds(
    List=pshift_38,
    DomainStart=number_slider_11,
    A=number_slider_11,
    List_2=pshift_38,
    DomainStart_2=number_slider_11,
    A_2=number_slider_11,
    List_3=trim_list_ends.List,
    List_4=trim_list_ends.List,
    Interval=trim_list_ends.Domain,
    Cycle=False,
    DomainStart_3=trim_list_ends.DomainStart,
    DomainEnd=trim_list_ends.Result,
    A_3=trim_list_ends.A,
    B=1,
    A_4=trim_list_ends.Length,
    B_2=trim_list_ends.Result,
    List_5=trim_list_ends.List,
    Index=trim_list_ends.Index,
    ClusterInput=[trim_list_ends, trim_list_ends, trim_list_ends],
    ClusterOutput=[trim_list_ends, trim_list_ends],
    InternalDocument_plugin_version=(0, 9, 76),
    InternalDocument_DocumentHeader_PreviewMeshType=1,
    InternalDocument_DocumentHeader_PreviewNormal=RGBA(150, 0, 0, 100),
    InternalDocument_DocumentHeader_PreviewSelected=RGBA(0, 120, 0, 100),
    InternalDocument_DefinitionProperties_Projection_Zoom=1.953125)  # -> List, Index, List_2, Index_2
merge_15 = Merge(Data1=long_6.ListA, Data2=long_6.ListC, Data3=long_6.ListB)
path = ConstructPath(Indices=merge_15)
pshift_39 = ShiftPaths(Data=trim_list_ends_2.List_2, Offset=-1)  # -> graft(Data)
split_2 = SplitTree(Data=weave_7, Masks=flatten(path))  # -> Positive, Negative
crvprox = CurveProximity(CurveA=pshift_35, CurveB=pline_14)  # -> PointA, PointB, Distance
planar_4 = Planar(Curve=pline_14)  # -> Planar, Plane, Deviation
division_13 = Division(A=crvprox.Distance, B=num_8)
offset_3 = Offset(Curve=pline_14, Distance=neg_7, Plane=planar_4.Plane, Corners=1)
subtraction_21 = Subtraction(A=Slider(1, range=0..1), B=division_13)
division_14 = Division(A=subtraction_21, B=2)
pshift_40 = ShiftPaths(Data=offset_3, Offset=-1)
multiplication_15 = Multiplication(A=num_8, B=division_14)
eval_12 = EvaluateCurve(Curve=split_2.Negative, Parameter=remap_7.Mapped)  # -> Point, Tangent, Angle
eval_13 = EvaluateCurve(Curve=split_2.Negative, Parameter=remap_8.Mapped)  # -> Point, Tangent, Angle
eval_14 = EvaluateCurve(Curve=split_2.Negative, Parameter=Slider(0.5, range=0..10))  # -> Point, Tangent, Angle
pt_8 = Point(eval_12.Point)
pt_9 = Point(eval_13.Point)
pt_10 = Point(eval_14.Point)
pshift_41 = ShiftPaths(Data=eval_13.Point, Offset=-1)
pl_3pt = Plane3Pt(PointA=pt_9, PointB=pt_8, PointC=pt_10)
offset_4 = Offset(Curve=pshift_35, Distance=multiplication_15, Plane=planar_3.Plane, Corners=1)
nurbs_6 = NurbsCurve(Vertices=pshift_41, Degree=3, Periodic=False)  # -> Curve, Length, Domain
neg_20 = Negative(Value=multiplication_15)
planar_5 = Planar(Curve=pshift_40)  # -> Planar, Plane, Deviation
pshift_42 = ShiftPaths(Data=pl_3pt, Offset=-1)
disc_4 = Discontinuity(Curve=offset_4, Level=1)  # -> Points, Parameters
reb_3 = RebuildCurve(Curve=nurbs_6.Curve, Count=Slider(6, range=0..10), Tangents=False)
offset_5 = Offset(Curve=pshift_40, Distance=neg_20, Plane=planar_5.Plane, Corners=1)
brep_7 = Brep(cap_2)
project_2 = Project(Geometry=reb_3, Plane=PlaneXY(0, 0, 0))  # -> Geometry, Transform
pcx_12 = CurvePlane(Curve=reb_3, Plane=pshift_42)  # -> Points, ParamsC, ParamsP
pline_15 = PolyLine(Vertices=disc_4.Points, Closed=True)
pshift_43 = ShiftPaths(Data=offset_5, Offset=-2)
pshift_44 = ShiftPaths(Data=pline_15, Offset=-3)
pshift_45 = ShiftPaths(Data=offset_5, Offset=-1)
pshift_46 = ShiftPaths(Data=pcx_12.ParamsC, Offset=-1)
pshift_47 = ShiftPaths(Data=pline_15, Offset=-2)
deplane_2 = DeconstructPlane(Plane=pl_3pt)  # -> Origin, XAxis, YAxis, ZAxis
debrep_2 = DeconstructBrep(Brep=brep_7)  # -> Faces, Edges, Vertices
pl_origin_2 = PlaneOrigin(Base=pl_3pt, Origin=pcx_12.Points)
group_2 = Group(Objects=pshift_43)
curvature = Curvature(Curve=project_2.Geometry, Parameter=pshift_46)  # -> P, K, C
group_3 = Group(Objects=pshift_44)
dprod_7 = DotProduct(VectorA=deplane_2.ZAxis, VectorB=Z_7, Unitize=False)
darc = DeconstructArc(Arc=curvature.C)  # -> BasePlane, Radius, Angle
item_8 = ListItem(List=debrep_2.Faces, Index=Slider(2, range=0..10), Wrap=True)
merge_16 = Merge(Data1=group_3, Data2=group_2)
p_n_c_8 = PickNChoose(Pattern=smooth_acrylic_movement, Stream0=pl_3pt, Stream1=pl_origin_2)
sort = SortList(Keys=darc.Radius)  # -> Keys, ValuesA
eval_15 = EvaluateCurve(Curve=project_2.Geometry, Parameter=pshift_46)  # -> Point, Tangent, Angle
smaller_4 = SmallerThan(FirstNumber=dprod_7, SecondNumber="0")  # -> SmallerThan, OrEqualTo
iso = IsoCurve(Surface=reparameterize(item_8), UVPoint="0.5,0.5,0")  # -> UIsocurve, VIsocurve
ungroup = Ungroup(Group=merge_16)  # -> graft(Objects)
align_5 = AlignPlane(Plane=p_n_c_8, Direction=Z_8)  # -> Plane, Angle
shift_3 = ShiftList(List=sort.Keys, Shift=-1, Wrap=False)
prot = RotatePlane(Plane=align_5.Plane, Angle=degrees(neg_9))
weave_8 = Weave(Pattern=smaller_4.SmallerThan, Stream0=neg_8, Stream1=addition_11, NullGaps=False)
pshift_48 = ShiftPaths(Data=shift_3, Offset=-1)
bnd_7 = Bounds(Numbers=pshift_48)
ext_5 = ExtendCurve(Curve=iso.UIsocurve, Type=0, Start=number_slider_20, End=number_slider_20)
remap_12 = RemapNumbers(Value=darc.Radius, Source=bnd_7, Target=dom_9)  # -> Mapped, Clipped
angle = Angle(VectorA=curvature.K, VectorB=eval_15.Tangent, Plane=xy_5)  # -> Angle, Reflex
boundary = BoundarySurfaces(Edges=ungroup)
pl_offset_2 = PlaneOffset(BasePlane=prot, Offset=weave_8)
line_5 = LineSDL(Start=curvature.P, Direction=curvature.K, Length=remap_12.Clipped)
subcrv_3 = SubCurve(BaseCurve=reparameterize(darc.Radius), Domain=dom_10)  # disabled
iso_2 = IsoCurve(Surface=reparameterize(item_8), UVPoint=Point(0.5, 0.5, 0))  # -> UIsocurve, VIsocurve
smaller_5 = SmallerThan(FirstNumber=angle.Angle, SecondNumber=pi_3)  # -> SmallerThan, OrEqualTo
crv_44 = Curve(boundary)
bbx = BrepBrep(BrepA=boundary, BrepB=flatten(item_8))  # -> Curves, Points
long_7 = LongestList(ListA=smaller_5.SmallerThan, ListB=graft_5, PaddingMode=2)  # -> ListA, graft(ListB)
orient_3 = Orient(Geometry=fillet, Source=align.Plane, Target=pl_offset_2)  # -> Geometry, Transform
pshift_49 = ShiftPaths(Data=bbx.Curves, Offset=-1)
crvprox_2 = CurveProximity(CurveA=crv_44, CurveB=flatten(iso_2.UIsocurve))  # -> PointA, PointB, Distance
flatten = FlattenTree(Tree=orient_3.Geometry, Path="{0}")
neg_21 = Negative(Value=long_7.ListB)
sort_2 = SortList(Keys=crvprox_2.Distance, ValuesA=crvprox_2.PointA, ValuesB=crvprox_2.PointB)  # -> Keys, ValuesA, ValuesB
p_n_c_9 = PickNChoose(Pattern=graft(long_7.ListA), Stream0=neg_21, Stream1=long_7.ListB)
len_4 = Length(Curve=flatten)
lng_5 = ListLength(List=flatten)
item_9 = ListItem(List=sort_2.ValuesA, Index=0, Wrap=True)

# ---- group: BOX BEAM REGION WIDTH
num_30 = Number(num_28)

# ----
ma_2 = MassAddition(Input=len_4)  # -> Result, PartialResults
division_15 = Division(A=num_30, B=2)
crv_cp_3 = CurveClosestPoint(Point=item_9, Curve=crv_44)  # -> Point, Parameter, Distance
multiplication_16 = Multiplication(A=graft(remap_12.Clipped), B=p_n_c_9)
lng_6 = ListLength(List=pshift_49)
division_16 = Division(A=ma_2.Result, B=12)
cir = Circle(Plane=crv_cp_3.Point, Radius=division_15)
ccx_5 = CurveCurve(CurveA=cir, CurveB=crv_44)  # -> Points, ParamsA, ParamsB
round_5 = Round(Number=division_16)  # -> Nearest, Floor, Ceiling

# ---- group: BEAMS
brep_8 = Brep(cap_2)

# ----
pshift_50 = ShiftPaths(Data=ccx_5.ParamsB, Offset=-1)
concat = Concatenate(FragmentA=small_panel_7, FragmentB=[lng_5, round_5.Ceiling], FragmentC=small_panel_8)
txt = Text(concat)
panel_2 = Panel(txt)
filter = StreamFilter(Gate=led_loop_orientation, Stream0="0", Stream1=merge_6, Stream2=multiplication_16)
bnd_8 = Bounds(Numbers=pshift_50)
debrep_3 = DeconstructBrep(Brep=brep_8)  # -> Faces, Edges, Vertices
subcrv_4 = SubCurve(BaseCurve=crv_44, Domain=bnd_8)
boundary_2 = BoundarySurfaces(Edges=ungroup)
item_10 = ListItem(List=debrep_3.Faces, Index=Slider(2, range=0..10), Wrap=True)
panel_3 = Panel(filter)
p_n_c_10 = PickNChoose(Pattern=lng_6, Stream0=subcrv_4, Stream1=pshift_49)
bbx_2 = BrepBrep(BrepA=boundary_2, BrepB=flatten(item_10))  # -> Curves, Points
rotate = Rotate(Geometry=orient_3.Geometry, Angle=degrees(filter), Plane=pl_offset_2)  # -> Geometry, Transform

# ---- group: LED CURVES
crv_45 = Curve(rotate.Geometry)

# ----
clean = CleanTree(RemoveNulls=True, RemoveInvalid=True, RemoveEmpty=True, Tree=crv_45)
long_8 = LongestList(ListA="LED CURVES", ListB=clean, PaddingMode=2)  # -> ListA, ListB; disabled
transform_3 = Transform(Geometry=item_5, Transform=orient_3.Transform)
pshift_51 = ShiftPaths(Data=bbx_2.Curves, Offset=-1)
planar_6 = IsPlanar(Surface=boundary_2, Interior=True)  # -> Planar, Plane
transform_4 = Transform(Geometry=transform_3, Transform=rotate.Transform)
cull_3 = CullPattern(List=rotate.Geometry, CullPattern=not_2)
end_6 = EndPoints(Curve=pshift_51)  # -> Start, End
mirror = Mirror(Geometry=transform_4, Plane=pl_offset_2)  # -> Geometry, Transform

# ---- group: LEDS CRVS
crv_46 = Curve(cull_3)

# ---- group: BEAM CENTERLINE
crv_47 = Curve(crv_41)

# ----
pl_origin_3 = PlaneOrigin(Base=planar_6.Plane, Origin=[end_6.Start, end_6.End])
path_mapper = PathMapper(p_n_c_10, source="{A;B;C;D}", target="{A;B;D}(C)")
p_n_c_11 = PickNChoose(Pattern=smaller_4.SmallerThan, Stream0=mirror.Geometry, Stream1=transform_4)
ext_6 = ExtendCurve(Curve=crv_47, Type=0, Start=number_slider_23, End=number_slider_23)
ungroup_2 = Ungroup(Group=p_n_c_11)
rotate_2 = Rotate(Geometry=pshift_51, Angle=degrees(merge_7), Plane=pl_origin_3)  # -> Geometry, Transform
pshift_52 = ShiftPaths(Data=ext_6, Offset=-1)
dispatch_2 = Dispatch(List=ungroup_2, DispatchPattern=[True, False])  # -> ListA, ListB
repeat_5 = RepeatData(Data=pshift_52, Length=int_15)
join_4 = JoinCurves(Curves=[rotate_2.Geometry, pshift_51], Preserve=False)
pshift_53 = ShiftPaths(Data=repeat_5, Offset=-1)  # -> graft(Data)
pshift_54 = ShiftPaths(Data=dispatch_2.ListB, Offset=-1)
pshift_55 = ShiftPaths(Data=dispatch_2.ListA, Offset=-1)
extr_3 = Extrude(Base=pshift_53, Direction=Z_9)
ext_7 = ExtendCurve(Curve=join_4, Type=0, Start=number_slider_24, End=number_slider_24)

# ---- group: LED BACK
brep_9 = Brep(pshift_54)

brep_10 = Brep(brep_9)

# ----
clean_2 = CleanTree(RemoveNulls=True, RemoveInvalid=True, RemoveEmpty=True, Tree=brep_10)
preview = CustomPreview(Geometry=brep_10, Shader=ColourSwatch(SwatchColor=RGB(210, 210, 210)))

# ---- group: LED LENSE
brep_11 = Brep(pshift_55)

brep_12 = Brep(brep_11)

# ----
clean_3 = CleanTree(RemoveNulls=True, RemoveInvalid=True, RemoveEmpty=True, Tree=brep_12)
preview_2 = CustomPreview(Geometry=brep_12, Shader=ColourSwatch(SwatchColor=RGB(255, 255, 0)))
disc_5 = Discontinuity(Curve=ext_7, Level=1)  # -> Points, Parameters
bcx = BrepCurve(Brep=extr_3, Curve=path_mapper)  # -> Curves, Points
pline_16 = PolyLine(Vertices=disc_5.Points, Closed=True)
pshift_56 = ShiftPaths(Data=bcx.Points, Offset=-1)
crv_48 = Curve(graft(path_mapper))
cir_2 = Circle(Plane=bcx.Points, Radius=addition_12)
pshift_57 = ShiftPaths(Data=pline_16, Offset=-2)
lng_7 = ListLength(List=pshift_56)
pline_17 = PolyLine(Vertices=pshift_56, Closed=False)
smaller_6 = SmallerThan(FirstNumber=lng_7, SecondNumber=Slider(2, range=0..10))  # -> SmallerThan, OrEqualTo
ccx_6 = CurveCurve(CurveA=cir_2, CurveB=crv_48)  # -> Points, ParamsA, ParamsB
eval_16 = MidPointOnCurve(Curve=reparameterize(pline_17), Parameter=0.5)  # -> Point, Tangent, Angle
rdiff = RegionDifference(CurvesA=ungroup, CurvesB=pshift_57, Plane=planar_6.Plane)
cull_4 = CullPattern(List=pshift_56, CullPattern=smaller_6.SmallerThan)
xy_6 = XYPlane(Origin=eval_16.Point)
fillet_3 = Fillet(Curve=rdiff, Radius=num_7)
cir_3 = Circle(Plane=ccx_6.Points, Radius=division_6)
project_3 = Project(Geometry=pshift_53, Plane=xy_6)  # -> Geometry, Transform
pshift_58 = ShiftPaths(Data=fillet_3, Offset=-1)

# ---- group: METAL CURVES
crv_49 = Curve(pshift_58)

# ----
path_mapper_2 = PathMapper(crv_49, source="{A;B;C;D}", target="{A;B;D}(C)")
len_5 = Length(Curve=crv_49)
ma_3 = MassAddition(Input=flatten(len_5))  # -> Result, PartialResults
clean_4 = CleanTree(RemoveNulls=True, RemoveInvalid=True, RemoveEmpty=True, Tree=path_mapper_2)
division_17 = Division(A=ma_3.Result, B="12")
long_9 = LongestList(ListA="METAL CURVES", ListB=clean_4, PaddingMode=2)  # -> ListA, ListB; disabled
round_6 = Round(Number=division_17)  # -> Nearest, Floor, Ceiling
feet = Panel(round_6.Ceiling)
division_18 = Division(A=feet, B="5280")
eval_17 = Evaluate(F="round(x,2)", x=division_18)
miles = Panel(eval_17)
pshift_59 = ShiftPaths(Data=cir_3, Offset=-2)
crv_cp_4 = CurveClosestPoint(Point=eval_16.Point, Curve=project_3.Geometry)  # -> Point, Parameter, Distance
dispatch_3 = Dispatch(List=pshift_58, DispatchPattern=_3d_geo)  # -> ListA, ListB

# ---- group: METAL LOOP ATTACHMENT HOLE
crv_50 = Curve(pshift_59)

# ----
eval_18 = EvaluateCurve(Curve=project_3.Geometry, Parameter=crv_cp_4.Parameter)  # -> Point, Tangent, Angle

# ---- group: mETAL CRVS
crv_51 = Curve(dispatch_3.ListB)

# ----
pipe_2 = Pipe(Curve=dispatch_3.ListA, Radius=num_8, Caps=0)
rev_5 = Reverse(Vector=eval_18.Tangent)
pshift_60 = ShiftPaths(Data=pipe_2, Offset=-1)
p_n_c_12 = PickNChoose(Pattern=pshift_28, Stream0=rev_5, Stream1=eval_18.Tangent)

# ---- group: METAL PIPES
brep_13 = Brep(pshift_60)

brep_14 = Brep(brep_13)

# ----
path_mapper_3 = PathMapper(brep_14, source="{A;B;C;D}", target="{A;B;D}(C)")
clean_5 = CleanTree(RemoveNulls=True, RemoveInvalid=True, RemoveEmpty=True, Tree=path_mapper_3)
long_10 = LongestList(ListA="Decorative Metal Pipes", ListB=clean_5, PaddingMode=2)  # -> ListA, ListB
preview_3 = CustomPreview(Geometry=brep_14, Shader=ColourSwatch(SwatchColor=RGB(120, 120, 120)))
align_6 = AlignPlane(Plane=xy_6, Direction=p_n_c_12)  # -> Plane, Angle
deplane_3 = DeconstructPlane(Plane=align_6.Plane)  # -> Origin, XAxis, YAxis, ZAxis
rectangle_3 = Rectangle(Plane=align_6.Plane, XSize=dom_11, YSize=dom_13, Radius=num_23)  # -> Rectangle, Length
rectangle_4 = Rectangle(Plane=align_6.Plane, XSize=[dom_14, neg_13], YSize=dom_12, Radius=num_23)  # -> Rectangle, Length
multiplication_17 = Multiplication(A=deplane_3.XAxis, B=addition_14)
multiplication_18 = Multiplication(A=deplane_3.YAxis, B=subtraction_18)
rev_6 = Reverse(Vector=multiplication_17)
rev_7 = Reverse(Vector=multiplication_18)
merge_17 = Merge(Data1=multiplication_17, Data2=rev_6)
merge_18 = Merge(Data1=multiplication_18, Data2=rev_7)
crossref = CrossReference(ListA=merge_17, ListB=merge_18, CrossMode=1)  # -> ListA, ListB
addition_20 = Addition(A=crossref.ListA, B=crossref.ListB)
addition_21 = Addition(A=deplane_3.Origin, B=addition_20)
cir_4 = Circle(Plane=addition_21, Radius=division_10)

# ---- group: METAL LOOP ATTACHMENT HOLE
crv_52 = Curve(crv_50)

# ----
dispatch_4 = Dispatch(List=[cir_4, rectangle_4.Rectangle], DispatchPattern=_3d_geo)  # -> ListA, ListB
dispatch_5 = Dispatch(List=[cir_4, rectangle_3.Rectangle, crv_52], DispatchPattern=_3d_geo)  # -> ListA, ListB
boundary_3 = BoundarySurfaces(Edges=dispatch_5.ListA)
boundary_4 = BoundarySurfaces(Edges=dispatch_4.ListA)
extr_4 = Extrude(Base=boundary_4, Direction=Z_10)
extr_5 = Extrude(Base=boundary_3, Direction=Z_11)
move_2 = Move(Geometry=extr_5, Motion=Z_12)  # -> Geometry, Transform
move_3 = Move(Geometry=extr_4, Motion=addition_15)  # -> Geometry, Transform

# ---- group: MOUNTING PLATES
brep_15 = Brep(move_2.Geometry)

brep_16 = Brep(brep_15)

# ----
long_11 = LongestList(ListA="MOUNTING_PLATES", ListB=brep_16, PaddingMode=2)  # -> ListA, ListB

# ---- group: BEAM TABS
brep_17 = Brep(move_3.Geometry)

brep_18 = Brep(brep_17)

# ----
long_12 = LongestList(ListA="BEAM_TABS", ListB=brep_18, PaddingMode=2)  # -> ListA, ListB

long_13 = LongestList(ListA="BACKING", ListB=clean_2, PaddingMode=2)  # -> ListA, ListB
long_14 = LongestList(ListA="LENS", ListB=clean_3, PaddingMode=2)  # -> ListA, ListB
merge_19 = Merge(
    Data1=long_14.ListA,
    Data2=long_13.ListA,
    Data3=long_10.ListA,
    Data4=long_9.ListA,
    Data5=long_8.ListA,
    Data6=merge_9,
    Data7=long_12.ListA,
    Data8=long_11.ListA)
merge_20 = Merge(
    Data1=long_14.ListB,
    Data2=long_13.ListB,
    Data3=long_10.ListB,
    Data4=long_9.ListB,
    Data5=long_8.ListB,
    Data6=merge_10,
    Data7=long_12.ListB,
    Data8=long_11.ListB)
glb = GroupLayerBakeV4(Geo=merge_20, Geo_LayerName=merge_19, Bake=Button())  # -> out, A; inputs Geo: tree of GeometryBase, Geo_LayerName: tree, Label: tree, Label_Pln: tree of Plane
# ---------- glb: VB ----------
    If( Not Bake ) Then Return

    Dim Group_Table As Rhino.DocObjects.Tables.GroupTable
    Group_Table = doc.Groups

    Dim Object_Table As Rhino.DocObjects.Tables.ObjectTable
    Object_Table = doc.Objects

    Dim Layer_Table As Rhino.DocObjects.Tables.LayerTable
    Layer_Table = doc.Layers

    Dim return_Guid As New List(Of Guid)

    For i As Integer = 0 To Geo.BranchCount - 1
      Dim Group_Index As Integer = Group_Table.Add()

      Dim att As New Rhino.DocObjects.ObjectAttributes
      att = doc.CreateDefaultAttributes

      For j As Integer = 0 To Geo.Branch(i).Count - 1

        'ADD TO GROUP


        Dim obj As GeometryBase = Geo.Branch(i).Item(j)

        att.AddToGroup(Group_Index)

        'BEGIN: PLACE ON LAYER
        If (Geo_LayerName.BranchCount > i) Then
          If (Geo_LayerName.Branch(i).Count > j) Then
            att.LayerIndex = getLayerIndex(Geo_LayerName.Branch(i).Item(j)) 'We simply add To the existing layer
          End If
        End If
        'END: PLACE ON LAYER

        Dim t As Integer = obj.ObjectType


        If t = 16 Then
          return_Guid.Add(Object_Table.AddBrep(obj, att))
        ElseIf t = 32 Then
          return_Guid.Add(Object_Table.AddMesh(obj, att))
        ElseIf t = 1 Then
          return_Guid.Add(Object_Table.AddPoint(DirectCast(obj, Rhino.Geometry.Point).Location, att))
        ElseIf t = 4 Then
          return_Guid.Add(Object_Table.AddCurve(obj, att))
        End If


      Next
      If (Label.BranchCount > i) Then
        If (Label.Branch(i).Count > 0) Then
          att.LayerIndex = getLayerIndex(Label_LayerName)
          Object_Table.AddText(Label.Branch(i).item(0), Label_Pln.Branch(i).item(0), Label_Size, "Arial", False, False, att)
        End If
      End If
    Next
    A = return_Guid
# ---------- glb: VB additional code ----------
  Function getLayerIndex(layer_name As String) As Integer

    Dim Layer_Table As Rhino.DocObjects.Tables.LayerTable
    Layer_Table = doc.Layers
    If  (Rhino.DocObjects.Layer.IsValidName(layer_name)) Then

      '//Get the current layer index
      'Rhino.DocObjects.Tables.LayerTable layerTable = doc.Layers
      Dim layerIndex As Integer = Layer_Table.Find(layer_name, True)

      If(layerIndex < 0) Then'//This layer does not exist, we add it

        Dim onlayer As  Rhino.DocObjects.Layer = New Rhino.DocObjects.Layer() 'Make a new layer
        onlayer.Name = layer_name

        'onlayer.Color = color
        layerIndex = Layer_Table.Add(onlayer) 'Add the layer to the layer table
        If (layerIndex > -1) Then 'We manged to add layer!

          getLayerIndex = layerIndex
        Else
          getLayerIndex = -1

        End If
      Else
        getLayerIndex = layerIndex 'We simply add To the existing layer
      End If
    Else
      getLayerIndex = -1
    End If
  End Function
# ---------- end glb ----------
